# Dynamo graph Adaptive Components from Edge Verticies.dyn (Dynamo 1.2.0.2690)

select_edge = DSEdgeSelection()  # 1 picked in the model
select_edge_2 = DSEdgeSelection()  # 1 picked in the model
create = List.Create(select_edge, select_edge_2)
endPoints = Geometry.Curves.EndPoints(create)
number = DoubleInput(0)
getItemAtIndex = List.GetItemAtIndex(list=endPoints.out0, index=number)
number_2 = DoubleInput(1)
getItemAtIndex_2 = List.GetItemAtIndex(list=endPoints.out1, index=number_2)
getItemAtIndex_3 = List.GetItemAtIndex(list=endPoints.out0, index=number_2)
getItemAtIndex_4 = List.GetItemAtIndex(list=endPoints.out1, index=number)
create_2 = List.Create(getItemAtIndex, getItemAtIndex_2, getItemAtIndex_3, getItemAtIndex_4)
create_3 = List.Create(create_2)
family_types = FamilyTypes("Family4:Family4")
byPoints = AdaptiveComponent.ByPoints(points=create_3, familyType=family_types)
