# Dynamo graph Area Boundaries to SAT.dyn (Dynamo 1.2.0.2690)

categories = Categories("AreaSchemeLines")
all_elements_of_category = ElementsOfCategory(categories)
file_path = Filename("C:\Temp\test.sat.sat")
code_block = CodeBlock(t1=all_elements_of_category, t2=file_path) { curve1 = t1.Curve; str1 = Geometry.ExportToSAT(curve1, t2); }
