# Dynamo graph Area Calculation to Comments.dyn (Dynamo 1.0.0.1180)

# group: Check Watch node and toggle Boolean to True if okay, re-run definition.
boolean = BoolSelector(true)

categories = Categories("CurtainWallPanels")
all_elements_of_category = ElementsOfCategory(categories)

# group: Run definition, check Watch node.
watch = Watch(all_elements_of_category)

runMe = Custom[Tool.RunMe](Boolean=boolean, ThingToDo=watch)  # Use Boolean to perform an action
string = StringInput("Comments")
string_2 = StringInput("Width")
getParameterValueByName = Element.GetParameterValueByName(element=all_elements_of_category, parameterName=string_2)
string_3 = StringInput("Height")
getParameterValueByName_2 = Element.GetParameterValueByName(element=all_elements_of_category, parameterName=string_3)
code_block = CodeBlock { 480; }
sub = getParameterValueByName_2 - code_block
mul = getParameterValueByName * sub
code_block_2 = CodeBlock { 1000000; }
div = mul / code_block_2
code_block_3 = CodeBlock { 1; }
round = Math.Round(number=div, digits=code_block_3)
toString = Custom[Number.ToString](num=round)  # Converts the input number(s) to string. Can process lists.
setParameterByName = Element.SetParameterByName(element=runMe, parameterName=string, value=toString)
