# Dynamo graph Create Sheets from Excel.dyn (Dynamo 1.0.0.1180)

file_path = Filename("R:\Dynamo\_Scripts\Create Sheets from Excel\Example-Drawing-List.xlsx")
# note: Input Your Excel File
fromPath = FileObject(file_path)  # "File.FromPath"

# group: Drawing Number & Title
# note: Type your Excel Sheet Name
type_your_excel_sheet_name = StringInput("Sheet1")
readFromFile = Excel.ReadFromFile(file=fromPath, sheetName=type_your_excel_sheet_name)
transpose = List.Transpose(readFromFile)
drawing_number_title = Watch(transpose)

# group: Drawing Title
number = DoubleInput(1)
drawing_title = List.GetItemAtIndex(list=drawing_number_title, index=number)
drawing_title_2 = Watch(drawing_title)

# group: Drawing Number
number_2 = DoubleInput(0)
drawing_number = List.GetItemAtIndex(list=drawing_number_title, index=number_2)
watch = Watch(drawing_number)

# group: Create Sheets
select_here_titleblocks_family = FamilyTypes("A1 metric:A1 metric")  # "Select here Titleblocks Family Types"
levels = Levels("Level 1")
byLevel = FloorPlanView.ByLevel(levels)
# note: Disregard this error. Check the Sheets in Revit to confirm success.
byNameNumberTitleBlockAndView = Sheet.ByNameNumberTitleBlockAndView(sheetName=drawing_title_2, sheetNumber=watch, titleBlockFamilyType=select_here_titleblocks_family, view=byLevel)
