# Dynamo graph Delete Elements by Category.dyn (Dynamo 1.0.0.1180)

# group: Edit Input here (5 Categories max.)
boolean = BoolSelector(true)
categories = Categories("Walls")
boolean_2 = BoolSelector(false)
categories_2 = Categories("Floors")
boolean_3 = BoolSelector(false)
categories_3 = Categories("Stairs")
boolean_4 = BoolSelector(false)
categories_4 = Categories("Parking")
boolean_5 = BoolSelector(false)
categories_5 = Categories("Furniture")

# group: Workflow, not for editing.
all_elements_of_category = ElementsOfCategory(categories)
runMe = Custom[Tool.RunMe](Boolean=boolean, ThingToDo=all_elements_of_category)  # Use Boolean to perform an action
all_elements_of_category_2 = ElementsOfCategory(categories_2)
runMe_2 = Custom[Tool.RunMe](Boolean=boolean_2, ThingToDo=all_elements_of_category_2)
all_elements_of_category_3 = ElementsOfCategory(categories_3)
runMe_3 = Custom[Tool.RunMe](Boolean=boolean_3, ThingToDo=all_elements_of_category_3)
all_elements_of_category_4 = ElementsOfCategory(categories_4)
runMe_4 = Custom[Tool.RunMe](Boolean=boolean_4, ThingToDo=all_elements_of_category_4)
all_elements_of_category_5 = ElementsOfCategory(categories_5)
runMe_5 = Custom[Tool.RunMe](Boolean=boolean_5, ThingToDo=all_elements_of_category_5)
create = List.Create(runMe, runMe_2, runMe_3, runMe_4, runMe_5)
flatten = Flatten(create)
count = List.Count(flatten)
bv_erase_or_delete_from_model = Custom[bv Erase or Delete from Model](Elements=create)  # forked from SteamNodes

string = StringInput("0")
replaceNulls = Lists.Manage.ReplaceNulls(bv_erase_or_delete_from_model, string)

# group (continued): Workflow, not for editing.
count_2 = List.Count(replaceNulls)
sub = count - count_2

# group: Number of elements deleted.
watch = Watch(sub)

containsItem = List.ContainsItem(list=bv_erase_or_delete_from_model, item=string)
filterByBoolMask = List.FilterByBoolMask(list=bv_erase_or_delete_from_model, mask=containsItem)

# group: Failed to delete Element ID's
watch_2 = Watch(filterByBoolMask.in)
