# Dynamo graph Delete Line Types By Name.dyn (Dynamo 1.0.0.1180)

# group: 01. Define Filter Criteria (i.e. IMPORT, ACAD, etc.)
string = StringInput("Lines")

# group: 03. Change to 'True' to delete elements. You must run the script again after.
delete_switch = BoolSelector(false)

# group: RUNNING SCRIPT WILL NOT AFFECT PROJECT UNTILL 'TRUE' IS SELECTED IN STEP 03.
empty = List.Empty()
element_types = ElementTypes("LinePatternElement")
all_elements_of_type = ElementsOfType(element_types)
name = Element.Name(all_elements_of_type)
contains = String.Contains(str=name, searchFor=string)
filterByBoolMask = List.FilterByBoolMask(list=all_elements_of_type, mask=contains)
create = List.Create(empty, filterByBoolMask.in)
flatten = Flatten(create)
python_script = Python(IN[0]=flatten, IN[1]=delete_switch)
# ---------- python_script.python (49 lines) ----------
#Copyright(c) 2015, Konrad Sobon
# @arch_laboratory, http://archi-lab.net

import clr
clr.AddReference('ProtoGeometry')
from Autodesk.DesignScript.Geometry import *

# Import DocumentManager and TransactionManager
clr.AddReference("RevitServices")
import RevitServices
from RevitServices.Persistence import DocumentManager
from RevitServices.Transactions import TransactionManager

# Import RevitAPI
clr.AddReference("RevitAPI")
import Autodesk
from Autodesk.Revit.DB import *

doc = DocumentManager.Instance.CurrentDBDocument
uiapp = DocumentManager.Instance.CurrentUIApplication
app = uiapp.Application

from System.Collections.Generic import *

#The inputs to this node will be stored as a list in the IN variable.
dataEnteringNode = IN
deleteBoolean = IN[1]
#unwrap all elements to use with API
elements = []
for i in IN[0]:
	elements.append(UnwrapElement(i))

idsToDelete = List[Autodesk.Revit.DB.ElementId]()
for i in elements:
	idsToDelete.Add(i.Id)

# "Start" the transaction
TransactionManager.Instance.EnsureInTransaction(doc)

if deleteBoolean:
	doc.Delete(idsToDelete)
	message = "You have successfully deleted \n " + str(idsToDelete.Count) + " elements from Revit model."
else:
	message = "Delete set to false."

# "End" the transaction
TransactionManager.Instance.TransactionTaskDone()

OUT = '\n'.join('{:^35}'.format(s) for s in message.split('\n'))
# ----------------------------------------
watch = Watch(python_script)
count = List.Count(all_elements_of_type)
watch_2 = Watch(count)
name_2 = Element.Name(filterByBoolMask.in)
watch_3 = Watch(name_2)

# group: 02. List of Line Types to be deleted CHECK before proceeding
watch_4 = Watch(name)
