# Dynamo graph Delete Unnamed Elements by Category.dyn (Dynamo 1.0.0.1180)

# group: Select Category
categories = Categories("CLines")

all_elements_of_category = ElementsOfCategory(categories)
string = StringInput("Name")
getParameterValueByName = Element.GetParameterValueByName(element=all_elements_of_category, parameterName=string)
length = String.Length(getParameterValueByName)
code_block = CodeBlock { 0; }
eq = length == code_block  # lacing=Longest
watch = Watch(eq)

# group: Run Category
boolean = BoolSelector(true)

filterByBoolMask = List.FilterByBoolMask(list=all_elements_of_category, mask=eq)
watch_2 = Watch(filterByBoolMask.in)
runMe = Custom[Tool.RunMe](Boolean=boolean, ThingToDo=watch_2)  # Use Boolean to perform an action
eraser = Custom[Tool.Eraser](Element_s=runMe)  # Try to delete any element from project
