# Dynamo graph Drafting View for Filled Region Types with Text Label.dyn (Dynamo 1.2.1.3083)

# group: Set view name
code_block = CodeBlock { "Filled Region Types"; }

# group: Input values - note project units
numbers_for_input = CodeBlock { 0; 250; 4; 45; 550; }

# group: Collect all filled region types and prepare lists for processing
element_types = ElementTypes("FilledRegionType")
all_elements_of_type = ElementsOfType(element_types)
name = FamilyType.Name(all_elements_of_type)
firstItem = List.FirstItem(name)
contains = String.Contains(str=name, searchFor=firstItem)
filterByBoolMask = List.FilterByBoolMask(list=all_elements_of_type, mask=contains)
firstItem_2 = List.FirstItem(filterByBoolMask.in)
count = Count(name)
code_block_2 = CodeBlock(a=count) { a; 0..a; }
create = List.Create(code_block_2.out1)
flatten = Flatten(create)
mul = flatten * numbers_for_input.out4
byCoordinates = Vector.ByCoordinates(x=numbers_for_input.out0, y=mul, z=numbers_for_input.out0)

# group: Create one filled region
byName = DraftingView.ByName(code_block)
P1 = Point.ByCoordinates(x=numbers_for_input.out0, y=numbers_for_input.out0)
byCenterPointRadius = Circle.ByCenterPointRadius(centerPoint=P1, radius=numbers_for_input.out1)
regularPolygon = Polygon.RegularPolygon(circle=byCenterPointRadius, numberSides=numbers_for_input.out2)
ZAxis = Vector.ZAxis()
rotate = Geometry.Rotate(geometry=regularPolygon, origin=P1, axis=ZAxis, degrees=numbers_for_input.out3)
explode = Geometry.Explode(rotate)
byCurves = FilledRegion.ByCurves(byName, explode, firstItem_2)

# group: Copy elements and remove extraneous one
copyByVector = Custom[Element.CopyByVector](element=byCurves, vector=byCoordinates)  # Copies an element or a list of elements by a given vector.
flatten_2 = Flatten(copyByVector)
lastItem = List.LastItem(flatten_2)

eraser = Custom[Tool.Eraser](Element_s=lastItem)  # Try to delete any element from project

# group: Set type name - change parameter to your locale
wait = Custom[Springs.Input.Wait](WaitForMe=eraser, Output=flatten_2)  # Waits for all inputs to be completed before continuing the execution process.Part of the SmartCopyMon workflow.
code_block_3 = CodeBlock { "Type"; }
setParameterByName = Element.SetParameterByName(element=wait, parameterName=code_block_3, value=all_elements_of_type)

# group: Create Tags
# note: From Spring Nodes
boolean = BoolSelector(true)
select_horizontal_text_alignment = HorizontalAlignment("Center")
select_vertical_text_alignment = VerticalAlignment("Bottom")
byElement = Tag.ByElement(byName, setParameterByName, boolean, boolean, select_horizontal_text_alignment, select_vertical_text_alignment)

# group: Delete dummy filled region
wait_2 = Custom[Springs.Input.Wait](WaitForMe=setParameterByName, Output=byCurves)

eraser_2 = Custom[Tool.Eraser](Element_s=wait_2)
