# Dynamo graph Drafting View for Lines by Line Style with Text Label.dyn (Dynamo 1.2.1.3083)

# group: Readme
# note: Cox Architecture
# Drafting View for Lines by Line Style with Text label
# Version 1.0
# Function
# This graph will create a new Dfrating View of a predetermined name (Input 1) with a Detail Line representing each of the Line Styles available in the Revit Project.
# Instruction
# Input 1: View Name
# Input 2: View Scale
# Input 3: View Type
# Input 4: Defaul Line Spacing

# group: Input 1:
view_name = CodeBlock { "Line Styles"; }

# group: Misc.
code_block = CodeBlock { 1000; }
projectUnitFactor = Custom[ProjectUnitFactor]()  # Creates a numerical factor to convert between project units bases on Millimater as 1
mul = code_block * projectUnitFactor

code_block_2 = CodeBlock { 0; }
byCoordinates = Point.ByCoordinates(x=mul, y=code_block_2)

# group: Get Line Styles
boolean = BoolSelector(true)
lineStyles = Custom[LineStyles](Bool=boolean)  # Collect all LineStyles in the file
count = Count(lineStyles.Element)
name = Family.Name(lineStyles.Element)

# group: Input 4:
default_spacing = CodeBlock { 0.01; }

# group: Input 2:
view_scale = CodeBlock { 25; }

# group: Input 3:
view_type = CodeBlock { "Annotation Categories"; }

# group: Create View
byName = DraftingView.ByName(view_name)
code_block_3 = CodeBlock { "View Scale"; "View Type"; }
setParameterByName = Element.SetParameterByName(element=byName, parameterName=code_block_3.out0, value=view_scale)
setParameterByName_2 = Element.SetParameterByName(element=setParameterByName, parameterName=code_block_3.out1, value=view_type)

# group: Create Text
code_block_4 = CodeBlock { "Lorem ipsum"; }
code_block_5 = CodeBlock { "Left"; 0; }
default = TextNoteType.Default()
byLocation = TextNote.ByLocation(view=byName, location=byCoordinates, text=code_block_4, alignment=code_block_5.out0, type=default, rotation=code_block_5.out1)

identity = Object.Identity(byLocation)

# group: Copy and set Text
code_block_6 = CodeBlock { 0; }
code_block_7 = CodeBlock(a=count) { a; 1..a; }
create = List.Create(code_block_7.out1)
flatten = Flatten(create)
div = default_spacing / projectUnitFactor
div_2 = flatten / div
byCoordinates_2 = Vector.ByCoordinates(x=code_block_6, y=div_2, z=code_block_6)
reverse = Vector.Reverse(byCoordinates_2)
copyByVector = Custom[Element.CopyByVector](element=identity, vector=reverse)  # Copies an element or a list of elements by a given vector.
setText = TextNote.SetText(copyByVector, name)

byCoordinates_3 = Point.ByCoordinates(x=code_block_2, y=code_block_2)
byStartPointEndPoint = Line.ByStartPointEndPoint(startPoint=byCoordinates_3, endPoint=byCoordinates)
byCurve = DetailCurve.ByCurve(setParameterByName_2, byStartPointEndPoint)

# group: Copy Lines
code_block_8 = CodeBlock { 0; }
code_block_9 = CodeBlock(a=count) { a; 1..a; }
create_2 = List.Create(code_block_9.out1)
flatten_2 = Flatten(create_2)
div_3 = default_spacing / projectUnitFactor
div_4 = flatten_2 / div_3
byCoordinates_4 = Vector.ByCoordinates(x=code_block_8, y=div_4, z=code_block_8)
reverse_2 = Vector.Reverse(byCoordinates_4)
copyByVector_2 = Custom[Element.CopyByVector](element=byCurve, vector=reverse_2)

flatten_3 = Flatten(copyByVector_2)
string = StringInput("Line Style")
identity_2 = Object.Identity(lineStyles.Element)
setParameterByName_3 = Element.SetParameterByName(element=flatten_3, parameterName=string, value=identity_2)

# group: Remove Reduncies
wait = Custom[Springs.Input.Wait](WaitForMe=setParameterByName_3, Output=byLocation)  # Waits for all inputs to be completed before continuing the execution process.Part of the SmartCopyMon workflow.
bv_erase_or_delete_from_model = Custom[bv Erase or Delete from Model](Element_s=wait)  # forked from SteamNodes
wait_2 = Custom[Springs.Input.Wait](WaitForMe=setParameterByName_3, Output=byCurve)
bv_erase_or_delete_from_model_2 = Custom[bv Erase or Delete from Model](Element_s=wait_2)
