# Dynamo graph Filled Region Area to Comments.dyn (Dynamo 1.0.0.1180)

# group: Check Watch node and toggle Boolean to True if okay, re-run definition.
boolean = BoolSelector(false)

element_types = ElementTypes("FilledRegion")
all_elements_of_type = ElementsOfType(element_types)

# group: Run definition, check Watch node.
watch = Watch(all_elements_of_type)

runMe = Custom[Tool.RunMe](Boolean=boolean, ThingToDo=watch)  # Use Boolean to perform an action
string = StringInput("Comments")
string_2 = StringInput("Area")
getParameterValueByName = Element.GetParameterValueByName(element=all_elements_of_type, parameterName=string_2)
toString = Custom[Number.ToString](num=getParameterValueByName)  # Converts the input number(s) to string. Can process lists.
setParameterByName = Element.SetParameterByName(element=runMe, parameterName=string, value=toString)
watch_2 = Watch(getParameterValueByName)
