# Dynamo graph Find-Replace Room Value.dyn (Dynamo 1.0.0.1180)

categories = Categories("Rooms")
all_elements_of_category = ElementsOfCategory(categories)
string = StringInput("Name")
bv_get_parameter_value_as_string = Custom[bv Get Parameter Value as String](Parameter_Name=string, Element_s=all_elements_of_category)  # forked from Rhythm
string_2 = StringInput("Room")
string_3 = StringInput("Boom")
replace = String.Replace(str=bv_get_parameter_value_as_string, searchFor=string_2, replaceWith=string_3)
set_list_of_values_to_list_of = Custom[Set List of Values to List of Elements for One Parameter](elementList=all_elements_of_category, parameterNameAsString=string, valuesToSet=replace)  # as described
watch = Watch(all_elements_of_category)
