# Dynamo graph Find-Replace Sheet Type Name.dyn (Dynamo 1.0.0.1180)

categories = Categories("Sheets")
all_elements_of_category = ElementsOfCategory(categories)
string = StringInput("Sheet Type")
bv_get_parameter_value_as_string = Custom[bv Get Parameter Value as String](Parameter_Name=string, Element_s=all_elements_of_category)  # forked from Rhythm

# group: F&R Fields
string_2 = StringInput("A2-00")
string_3 = StringInput("A2-00 TEST")

replace = String.Replace(str=bv_get_parameter_value_as_string, searchFor=string_2, replaceWith=string_3)
set_list_of_values_to_list_of = Custom[Set List of Values to List of Elements for One Parameter](elementList=all_elements_of_category, parameterNameAsString=string, valuesToSet=replace)  # as described
