# Dynamo graph Find-Replace Value.dyn (Dynamo 0.9.0.3067)

element_types = ElementTypes("ViewSheet")
all_elements_of_type = ElementsOfType(element_types)
string = StringInput("Sheet Number")
bv_get_parameter_value_as_string = Custom[bv Get Parameter Value as String](Parameter_Name=string, Element_s=all_elements_of_type)  # forked from Rhythm
string_2 = StringInput("AR-")
string_3 = StringInput("")
replace = String.Replace(str=bv_get_parameter_value_as_string, searchFor=string_2, replaceWith=string_3)
set_list_of_values_to_list_of = Custom[Set List of Values to List of Elements for One Parameter](elementList=all_elements_of_type, parameterNameAsString=string, valuesToSet=replace)  # as described
