# Dynamo graph GA & RCP Creator.dyn (Dynamo 1.0.0.1180)

categories = Categories("Levels")
all_elements_of_category = ElementsOfCategory(categories)
byLevel = FloorPlanView.ByLevel(all_elements_of_category)
string = StringInput(" GA")
rename_views_by_appending = Custom[Rename Views by Appending Selected Suffix](viewListIn=byLevel, suffixToAppend=string)
string_2 = StringInput("View Name")
getParameterValueByName = Element.GetParameterValueByName(element=rename_views_by_appending, parameterName=string_2)
ga_sheet_series = CodeBlock { 0700; }
count = Count(rename_views_by_appending)
step = CodeBlock { 10; }
sequence = Sequence(start=ga_sheet_series, amount=count, step=step)

# group: Select Titleblock
titleblock = FamilyTypes("A1 metric:A1 metric")

# group: Define Template (Must exist in Project prior)
view_template_name = StringInput("Architectural Plan")

applyViewTemplate = Custom[View.ApplyViewTemplate](View_s=rename_views_by_appending, View_Template_Name=view_template_name)  # Applies a view template to any given view(s). Supply a string with a view template name.
byNameNumberTitleBlockAndViews = Sheet.ByNameNumberTitleBlockAndViews(getParameterValueByName, sequence, titleblock, applyViewTemplate)
level = Custom[Element.Level](element=rename_views_by_appending)  # Gets an element's level
byLevel_2 = CeilingPlanView.ByLevel(level)
string_3 = StringInput(" RCP")
rename_views_by_appending_2 = Custom[Rename Views by Appending Selected Suffix](viewListIn=byLevel_2, suffixToAppend=string_3)
getParameterValueByName_2 = Element.GetParameterValueByName(element=rename_views_by_appending_2, parameterName=string_2)
string_from_array = FromArray(getParameterValueByName_2)
rcp_sheet_series = CodeBlock { 0500; }
count_2 = Count(rename_views_by_appending_2)
step_2 = CodeBlock { 10; }
sequence_2 = Sequence(start=rcp_sheet_series, amount=count_2, step=step_2, lacing=Longest)
string_from_array_2 = FromArray(sequence_2)

# group: Define Template (Must exist in Project prior)
view_template_name_2 = StringInput("Architectural Reflected Ceiling Plan")

applyViewTemplate_2 = Custom[View.ApplyViewTemplate](View_s=byLevel_2, View_Template_Name=view_template_name_2)
byNameNumberTitleBlockAndViews_2 = Sheet.ByNameNumberTitleBlockAndViews(string_from_array, string_from_array_2, titleblock, applyViewTemplate_2)
