# Dynamo graph Join Geometry.dyn (Dynamo 1.0.0.1180)

categories = Categories("GenericModel")
all_elements_of_category = ElementsOfCategory(categories)
watch = Watch(all_elements_of_category)
code_block = CodeBlock { 0; }
getItemAtIndex = List.GetItemAtIndex(list=watch, index=code_block)
family_types = FamilyTypes("ADCP_8pt-Louvre:ADCP_8pt-Louvre")
all_elements_of_family_type = ElementsOfFamilyType(family_types)
joinGeometry = Custom[Element.JoinGeometry](element1=getItemAtIndex, element2=all_elements_of_family_type, lacing=Longest)  # Joins two model elements (if possible). Only works inside the project environment.
boolean = BoolSelector(false)
runMe = Custom[Tool.RunMe](Boolean=boolean, ThingToDo=getItemAtIndex)  # Use Boolean to perform an action
watch_2 = Watch(getItemAtIndex)
