# Dynamo graph Mass Elements by Rooms.dyn (Dynamo 1.0.0.1180)

closeWithLine = PolyCurve.CloseWithLine()
categories = Categories("Rooms")
all_elements_of_category = ElementsOfCategory(categories)
boundaries = Custom[Room.Boundaries](room=all_elements_of_category)  # Gets a list of all boundary elements of a given room or area
endPoint = Curve.EndPoint(boundaries.curves)
byPoints = Polygon.ByPoints(endPoint)
center = Polygon.Center(byPoints)
ZAxis = Vector.ZAxis()
code_block = CodeBlock { 1; }
views = Views("{3D}")
byOriginDirection = Revit.References.RayBounce.ByOriginDirection(center, ZAxis, code_block, views)
flatten = List.Flatten(list=byOriginDirection, amt=code_block)
code_block_2 = CodeBlock { 2; }
code_block_3 = CodeBlock { 2; }
takeEveryNthItem = List.TakeEveryNthItem(flatten, code_block_2, code_block_3)
Z = Point.Z(takeEveryNthItem)
extrudeAsSolid = Curve.ExtrudeAsSolid(byPoints, Z)
getElementsContaining = Custom[GetElementsContaining](Element_Types=all_elements_of_category)  # This node search the selected element type for a inputvalue(string) and returns a list of the elements containing the given input.
