# Dynamo graph Model Audit.dyn (Dynamo 1.2.0.2690)

boolean = BoolSelector(true)
collectRevitLinks = Custom[CollectRevitLinks](bool=boolean)  # Collect all Revit Links in the current model.
all_elements_of_family_type = Custom[All Elements of Family Type (Universal)](familyType=collectRevitLinks.Element, toggle=boolean)  # Unlike the built-in node, this node retrieves all placed instances of a given loadable *or* system family type
count = List.Count(all_elements_of_family_type@@L2)
watch = Watch(count)
linksAndImports = Custom[Document.LinksAndImports](toggle=boolean)  # Gets all linked and imported files in the document. NOTE: Does *not* retrieve linked Revit files.
watch_2 = Watch(linksAndImports.links)
watch_3 = Watch(collectRevitLinks.Name)
collectModelGroups = Custom[CollectModelGroups](bool=boolean)  # Collect all Model Groups in the current model.
countOccurences = Custom[List.CountOccurences](seq=collectModelGroups.Name)  # Counts the number of occurences of each unique element in a given list
watch_4 = Watch(countOccurences.uniqueElements)
watch_5 = Watch(countOccurences.count)
code_block = CodeBlock { 1; }
eq = watch_5 == code_block
filterByBoolMask = List.FilterByBoolMask(list=collectModelGroups.Element, mask=eq)
ungroup = Custom[Group.Ungroup](group=filterByBoolMask.in)  # Ungroups a group and returns the ungrouped elements.
get_all_detail_groups = Custom[Get All Detail Groups]()  # This node will retrieve all instances of Detail Groups in the model.
countOccurences_2 = Custom[List.CountOccurences](seq=get_all_detail_groups.Group_Names)
watch_6 = Watch(countOccurences_2.uniqueElements)
watch_7 = Watch(countOccurences_2.count)
code_block_2 = CodeBlock { 1; }
eq_2 = watch_7 == code_block_2
filterByBoolMask_2 = List.FilterByBoolMask(list=get_all_detail_groups.Groups, mask=eq_2)
ungroup_2 = Custom[Group.Ungroup](group=filterByBoolMask_2.in)
get_unplaced_groups = Custom[Get Unplaced Groups]()  # This node will retrieve all unplaced groups in the model.
delete_elements = Custom[Delete Elements](Elements=get_unplaced_groups.Groups, Delete=boolean)  # This node will delete elements from Revit project.
watch_8 = Watch(delete_elements)
categories = Categories("Views")
all_elements_of_category = ElementsOfCategory(categories)
collectSheets = Custom[CollectSheets](bool=boolean)  # Collect all Sheets in the current model for auditing purposes
views = Sheet.Views(collectSheets.Element)
flatten = Flatten(views)
categories_2 = Categories("Views")
all_elements_of_category_2 = ElementsOfCategory(categories_2)
removeNulls = Lists.Manage.RemoveNulls(all_elements_of_category_2)
code_block_3 = CodeBlock { "View Type"; "999"; "Number"; }
getParameterValueByName = Element.GetParameterValueByName(element=removeNulls, parameterName=code_block_3.out0)
contains = String.Contains(str=getParameterValueByName, searchFor=code_block_3.out1)
filterByBoolMask_3 = List.FilterByBoolMask(list=removeNulls, mask=contains)
create = List.Create(flatten, filterByBoolMask_3.in)
flatten_2 = Flatten(create)
containsItem = List.ContainsItem(list=flatten_2, item=all_elements_of_category)
filterByBoolMask_4 = List.FilterByBoolMask(list=all_elements_of_category, mask=containsItem)
watch_9 = Watch(filterByBoolMask_4.out)
boolean_2 = BoolSelector(true)
delete_elements_2 = Custom[Delete Elements](Elements=watch_9, Delete=boolean_2)
collectCADLinks = Custom[CollectCADLinks](bool=boolean)  # Collect all CAD Links in the current model.
watch_10 = Watch(collectCADLinks.Element)
all_elements_of_family_type_2 = Custom[All Elements of Family Type (Universal)](familyType=watch_10, toggle=boolean)
count_2 = List.Count(all_elements_of_family_type_2@@L2)
watch_11 = Watch(count_2)
lunchbox_placed_and_unplaced = Custom[LunchBox Placed and Unplaced Rooms](Toggle=boolean)  # Finds placed and unplaced rooms
watch_12 = Watch(lunchbox_placed_and_unplaced.Placed_Room)
getParameterValueByName_2 = Element.GetParameterValueByName(element=lunchbox_placed_and_unplaced.Placed_Room, parameterName=code_block_3.out2)
lineStyles = Custom[LineStyles](Bool=boolean)  # Collect all LineStyles in the file
watch_13 = Watch(lineStyles.Name)
count_3 = Count(watch_13)
watch_14 = Watch(count_3)
code_block_4 = CodeBlock { "A-SAT"; "A-DWG"; }
create_2 = Custom[Workset.Create](names=code_block_4.out0)  # Creates worksets, input is a string or list of strings. Existing worksetnames are ignored.
SATtoWorkset = Custom[SATtoWorkset](Workset=create_2)  # Send all SATs not in a group to a given workset.
watch_15 = Watch(SATtoWorkset.Unchanged)
watch_16 = Watch(SATtoWorkset.Succeeded)
watch_17 = Watch(SATtoWorkset.Failed)
create_3 = Custom[Workset.Create](names=code_block_4.out1)
DWGtoWorkset = Custom[DWGtoWorkset](Workset=create_3)  # Send all DWGs not in groups to a given workset.
watch_18 = Watch(DWGtoWorkset.Unchanged)
watch_19 = Watch(DWGtoWorkset.Failed)
watch_20 = Watch(DWGtoWorkset.Succeeded)
collectMaterials = Custom[CollectMaterials](bool=boolean)  # Collect all Materials in the currect model.
watch_21 = Watch(collectMaterials.Element)
collectFillPatterns = Custom[CollectFillPatterns](bool=boolean)  # Collect all Fill Patterns in the current model.
watch_22 = Watch(collectFillPatterns.Name)
count_4 = Count(watch_22)
watch_23 = Watch(count_4)
collectLevels = Custom[CollectLevels](bool=boolean)  # Collect all levels in the current project.
watch_24 = Watch(collectLevels.Name)
count_5 = Count(watch_24)
watch_25 = Watch(count_5)
getParameterValueByName_3 = Element.GetParameterValueByName(element=collectFillPatterns.Element)  # unwired: parameterName
parameters = Element.Parameters(collectFillPatterns.Element)
watch_26 = Watch(parameters)
collectDimensionStyles = Custom[CollectDimensionStyles](bool=boolean)  # Collect all Dimension Styles in the current model.
watch_27 = Watch(collectDimensionStyles.Name)
count_6 = Count(watch_27)
watch_28 = Watch(count_6)
create_annotation_tag = Custom[Create Annotation Tag]()  # This node will create an annotation tag at a given location, of given type and in a supplied view. If only single view is supplied then all tags will be created in that view.; unwired: Locations, TagType, Elements, Views, Run
family_types = FamilyTypes("ANN_Down_Light_Surface:Type 1")
readFromFile = Excel.ReadFromFile()  # unwired: file, sheetName
file_path = Filename("T:\narsai-a\20161020%20ARC_RLA_RVT16_CENTRAL_m-anarsai_Error%20Report.html")
string = StringInput("Sheet Number is already in use. Enter a unique number.")
python_script = Python(IN[0]=file_path, IN[1]=string)
# ---------- python_script.python (53 lines) ----------
# Copyright(c) 2016, Konrad K Sobon
# @arch_laboratory, http://archi-lab.net

import clr
import sys
pyt_path = r'C:\Program Files (x86)\IronPython 2.7\Lib'
sys.path.append(pyt_path)

lib_path = r'C:\Program Files (x86)\IronPython 2.7\Lib\BeautifulSoup-3.2.1'
sys.path.append(lib_path)

from BeautifulSoup import BeautifulSoup
import re

#The inputs to this node will be stored as a list in the IN variable.
dataEnteringNode = IN

file_path = str(IN[0])
file = open(file_path, "r")
err_type, txt4 = [], []
err_name = IN[1]

soup = BeautifulSoup(file)
tag = soup.findAll('tr')

for i in tag:
	txt = str(i.text)
	txt2 = txt.rpartition(".")
	txt3 = txt2[0].split(".")
	#Create list of ALL error types in file
	err_type.append(txt3[0])
	#get strings from rows
	txt4.append(str(txt2[-1]))
#get total number of warnings
total_warnings = len(err_type)
#get number of warnings for type specified
type_warnings = err_type.count(err_name)
#parse the properties cell for element IDs	
pattern = re.compile(r"\bid\s*?(\d+)")
ids = ["; ".join(pattern.findall(item)) for item in txt4]
#create filtered sets that contain only specified type of error
err, id = set(), []
for i, j in zip(err_type, ids):
	if i == err_name:
		err.add(i)
		id.append(j)
#combine all ids into one string for use with Revit
final_ids = list(id)
str_ids = ' ;'.join(str(elem) for elem in final_ids)
#create a list of individual ids
list_ids = set(str_ids.replace(" ", "").split(";"))
#define outputs
OUT = err, list_ids, total_warnings, type_warnings
# ----------------------------------------
watch_29 = Watch(python_script)
dataFromCSV = Charts.BarChart.DataFromCSV()  # unwired: arg0
data = Charts.GroupedBarChart.Data()  # unwired: arg0, arg1
watch_30 = Watch(linksAndImports.imports)
data_2 = Charts.GroupedBarChart.Data(arg1=watch_30)  # unwired: arg0
style = Text.Text.Style()
chart = Charts.GroupedBarChart.Chart(data_2, style)
