# Dynamo graph Place Family by Points.dyn (Dynamo 1.2.0.2690)

file_path = Filename(".\flatDataStream.csv")
fromPath = FileObject(file_path)  # "File.FromPath"
code_block = CodeBlock(t5=fromPath)
# ---------- code_block.designscript (5 lines) ----------
t4 = CSV.ReadFromFile(t5);
t6 = List.Transpose(t4);
t7 = List.GetItemAtIndex(t6, 0);
t8 = List.GetItemAtIndex(t6, 1);
t9 = List.GetItemAtIndex(t6, 2);
# ----------------------------------------
code_block_2 = CodeBlock { "{"; "}"; ""; }
changeAllCharactersTo = Custom[String.ChangeAllCharactersTo](String=code_block.t7, ChangeFrom=code_block_2.out0, ChangeTo=code_block_2.out2)  # Changes all the given characters to the new value
string_from_object = FromObject(code_block.t8)
changeAllCharactersTo_2 = Custom[String.ChangeAllCharactersTo](String=code_block.t9, ChangeFrom=code_block_2.out1, ChangeTo=code_block_2.out2)
family_types = FamilyTypes("Hangar sprinkler with escutcheon:Hangar sprinkler with escutcheon")
code_block_3 = CodeBlock(t2=changeAllCharactersTo, t4=string_from_object, t6=changeAllCharactersTo_2, t7=family_types)
# ---------- code_block_3.designscript (5 lines) ----------
t1 = String.ToNumber(t2);
t3 = String.ToNumber(t4);
t5 = String.ToNumber(t6);
point1 = Point.ByCoordinates(t1, t3, t5);
familyinstance1 = FamilyInstance.ByPoint(t7, point1);
# ----------------------------------------
watch = Watch(code_block_3.familyinstance1)
