# Dynamo graph Push Door Number to Comments.dyn (Dynamo 0.9.0.3067)

categories = Categories("Doors")
all_elements_of_category = ElementsOfCategory(categories)
string = StringInput("Comments")
string_2 = StringInput("Room Number")
bv_get_parameter_value_from_type = Custom[bv Get Parameter value from Type or Instance](element=all_elements_of_category, parameterName=string_2)  # forked from Rhythm
setParameterByName = Element.SetParameterByName(element=all_elements_of_category, parameterName=string, value=bv_get_parameter_value_from_type)
parameters = Element.Parameters(all_elements_of_category)
