# Dynamo graph Push Element IDs.dyn (Dynamo 0.9.0.3067)

categories = Categories("Rooms")
all_elements_of_category = ElementsOfCategory(categories)
string = StringInput("Comments")
element_ids = Custom[Element Ids](Element_s=all_elements_of_category)  # This node will query an element id that can be used with Revit nodes. Dynamo Element Id node returns integer value.
setParameterByName = Element.SetParameterByName(element=all_elements_of_category, parameterName=string, value=element_ids.Id_String_s)
watch = Watch(element_ids.Id_String_s)
