# Dynamo graph Renumber Sheet from Excel.dyn (Dynamo 1.0.0.1180)

categories = Categories("Sheets")
all_elements_of_category = ElementsOfCategory(categories)
code_block = CodeBlock { "Sheet Number"; }
getParameterValueByName = Element.GetParameterValueByName(element=all_elements_of_category, parameterName=code_block)

# group: Excel File
file_path = Filename(".\Renumber%20Sheets%20from%20Excel.xlsx")

fromPath = FileObject(file_path)  # "File.FromPath"
code_block_2 = CodeBlock { "Sheet1"; }
boolean = BoolSelector(false)
readFromFile = Excel.ReadFromFile(file=fromPath, sheetName=code_block_2, readAsStrings=boolean)
transpose = List.Transpose(readFromFile)
code_block_3 = CodeBlock { 0; }
getItemAtIndex = List.GetItemAtIndex(list=transpose, index=code_block_3)
restOfItems = List.RestOfItems(getItemAtIndex)
code_block_4 = CodeBlock { 1; }
getItemAtIndex_2 = List.GetItemAtIndex(list=transpose, index=code_block_4)
restOfItems_2 = List.RestOfItems(getItemAtIndex_2)
replace = Custom[ListString.Replace](StrOrList=getParameterValueByName, SearchFor=restOfItems, ReplaceWith=restOfItems_2)  # This node make a loop to search for a list of strings and replace with an another. The previous change is use for the next search replacement. Works with a string element or a list of string elements,

# group: Monitor, execute.
boolean_2 = BoolSelector(false)
watch = Watch(replace)

runMe = Custom[Tool.RunMe](Boolean=boolean_2, ThingToDo=watch)  # Use Boolean to perform an action
setParameterByName = Element.SetParameterByName(element=all_elements_of_category, parameterName=code_block, value=runMe)
