# Dynamo graph Replace Family by Type.dyn (Dynamo 1.2.0.2690)

boolean = BoolSelector(true)
family_types = FamilyTypes("M_RPC Tree - Deciduous:Scarlet Oak - 12.5 Meters")
lunchbox_family_instance = Custom[LunchBox Family Instance Collector](Toggle=boolean, FamilyType=family_types)  # Collects Family Instances from the Revit Doc
delete_elements = Custom[Delete Elements](Elements=lunchbox_family_instance.Element, Delete=boolean)  # This node will delete elements from Revit project.
watch = Watch(delete_elements)
family_types_2 = FamilyTypes("M_RPC Shrub:Pampas Grass - 2.44 Meters")
byPoint = FamilyInstance.ByPoint(familyType=family_types_2, point=lunchbox_family_instance.Location)
watch_2 = Watch(byPoint)
