# Dynamo graph Rhino Curves to Structural Framing.dyn (Dynamo 0.9.0.3067)

file_path = Filename("\\melsrv01\projects\~2014\314033.00_RodLaver-Arena\Draw\3D\Rhino\Guido\RHS Rhino1.3dm")
get_RhinoFile = Interoperability.ReadRhino.OpenRhino3dmModel.Get_RhinoFile(file_path)
get_RhinoLayerNames = Interoperability.ReadRhino.RhinoObject.Get_RhinoLayerNames(get_RhinoFile)
code_block = CodeBlock { 7; }
getItemAtIndex = List.GetItemAtIndex(list=get_RhinoLayerNames, index=code_block)
get_RhinoObjectsByLayer = Interoperability.ReadRhino.RhinoObject.Get_RhinoObjectsByLayer(get_RhinoFile, getItemAtIndex)
rhino_CurvesToDS = Interoperability.ReadRhino.RhinoTranslationToDS.Rhino_CurvesToDS(get_RhinoObjectsByLayer)
explode = Geometry.Explode(rhino_CurvesToDS)
byCurve = ModelCurve.ByCurve(explode)
get_RhinoLayerNames_2 = Interoperability.ReadRhino.RhinoObject.Get_RhinoLayerNames(get_RhinoFile)
code_block_2 = CodeBlock { 2; }
getItemAtIndex_2 = List.GetItemAtIndex(list=get_RhinoLayerNames_2, index=code_block_2)
get_RhinoObjectsByLayer_2 = Interoperability.ReadRhino.RhinoObject.Get_RhinoObjectsByLayer(get_RhinoFile, getItemAtIndex_2)
rhino_CurvesToDS_2 = Interoperability.ReadRhino.RhinoTranslationToDS.Rhino_CurvesToDS(get_RhinoObjectsByLayer_2)
explode_2 = Geometry.Explode(rhino_CurvesToDS_2)
endPoints = Geometry.Curves.EndPoints(explode_2)
levels = Levels("LEVEL G")
structural_framing_types = StructuralFramingTypes("200x100×4.0 RHS")
beamByCurve = StructuralFraming.BeamByCurve(curve=explode_2, level=levels, structuralFramingType=structural_framing_types)
code_block_3 = CodeBlock { Center; }
instance_parameter_z = Custom[Instance.Parameter.z Justification](Revit_Element=beamByCurve, z_Justification_str=code_block_3)  # Adjusting the z justification of an element
