# Dynamo graph Room Ceiling Heights.dyn (Dynamo 1.0.0.1180)

categories = Categories("Rooms")
all_elements_of_category = ElementsOfCategory(categories)
string = StringInput("Limit Offset")
boundaries = Custom[Room.Boundaries](room=all_elements_of_category)  # Gets a list of all boundary elements of a given room or area
endPoint = Curve.EndPoint(boundaries.curves)
byPoints = Polygon.ByPoints(endPoint)
center = Polygon.Center(byPoints)
ZAxis = Vector.ZAxis()
code_block = CodeBlock { 1; }
views = Views("{3D}")
byOriginDirection = Revit.References.RayBounce.ByOriginDirection(center, ZAxis, code_block, views)
flatten = List.Flatten(list=byOriginDirection, amt=code_block)
code_block_2 = CodeBlock { 2; }
code_block_3 = CodeBlock { 2; }
takeEveryNthItem = List.TakeEveryNthItem(flatten, code_block_2, code_block_3)
Z = Point.Z(takeEveryNthItem)
setParameterByName = Element.SetParameterByName(element=all_elements_of_category, parameterName=string, value=Z)
