# Dynamo graph Room Number as Mark Value by Category.dyn (Dynamo 0.9.0.3067)

categories = Categories("Furniture")
all_elements_of_category = ElementsOfCategory(categories)
boolean = BoolSelector(true)
lunchbox_room_element_collector = Custom[LunchBox Room Element Collector](Toggle=boolean)  # Collects rooms from the Revit document
code_block = CodeBlock { "Number"; }
code_block_2 = CodeBlock { "Name"; }
code_block_3 = CodeBlock { "Mark"; }
code_block_4 = CodeBlock { "Comments"; }
collect_elements_in_rooms_and = Custom[Collect Elements in Rooms and Show Detailed List](Elements=all_elements_of_category, Rooms=lunchbox_room_element_collector.Element, RoomParameterOne=code_block, RoomParameterTwo=code_block_2, ElementParameterOne=code_block_3, ElementParameterTwo=code_block_4)  # Allows you to generate various lists of elements in rooms. Can get two parameters for Rooms, and two for Elements. Based on Family.InRoom work by Konrad, which was built on others.
setParameterByName = Element.SetParameterByName(element=collect_elements_in_rooms_and.ElementsInRooms, parameterName=code_block_3, value=collect_elements_in_rooms_and.RoomParameterOne)
collect_all_familyinstance_using = Custom[Collect all FamilyInstance using Element Types]()  # should get model family instances
code_block_5 = CodeBlock { 1; }
count = List.Count(collect_elements_in_rooms_and.ElementsInRooms)
code_block_6 = CodeBlock { 1; }
sequence = Sequence(start=code_block_5, amount=count, step=code_block_6, lacing=Longest)
setParameterByName_2 = Element.SetParameterByName(element=collect_elements_in_rooms_and.ElementsInRooms, parameterName=code_block_4, value=sequence)
