# Dynamo graph Scale Text in Text Types and Dimensin Styles.dyn (Dynamo 1.2.1.3083)

element_types = ElementTypes("TextElementType")
all_elements_of_type = ElementsOfType(element_types)
element_types_2 = ElementTypes("DimensionType")
all_elements_of_type_2 = ElementsOfType(element_types_2)
create = List.Create(all_elements_of_type, all_elements_of_type_2)
flatten = Flatten(create)
code_block = CodeBlock { "Text Size"; }
getParameterValueByName = Element.GetParameterValueByName(element=flatten, parameterName=code_block)
watch = Watch(getParameterValueByName)
scale_factor = CodeBlock { 1.0; }
mul = watch * scale_factor
setParameterByName = Element.SetParameterByName(element=flatten, parameterName=code_block, value=mul)
watch_2 = Watch(mul)
