# Dynamo graph Set Phase by Elements in View.dyn (Dynamo 1.0.0.1180)

active_view = Custom[Active View]()  # Selects the current document's active view. Supports more view types than the built-in option. Will be depreciated once the bult in node works with all plan types.
bv_elements_in_views = Custom[bv Elements in Views](Views=active_view)  # forked
string = StringInput("Phase")
code_block = CodeBlock { "Stage 1"; }
setParameterByName = Element.SetParameterByName(element=bv_elements_in_views, parameterName=string, value=code_block)
