# Dynamo graph Set Sheet Issue Date.dyn (Dynamo 1.0.0.1180)

categories = Categories("Sheets")
all_elements_of_category = ElementsOfCategory(categories)
string = StringInput("Sheet Issue Date")

# group: 1. Field to edit
sheet_issue_date = StringInput("NOT ISSUED")

setParameterByName = Element.SetParameterByName(element=all_elements_of_category, parameterName=string, value=sheet_issue_date)
