# Dynamo graph Set Top Constraint Associated to Level Above.dyn (Dynamo 1.0.0.1180)

# group: 3. Walls at Level to edit
levels = Levels("01 - Entry Level")

all_elements_at_level = ElementsAtLevel(levels)

# group: 1 Select Caregory to edit
categories = Categories("StructuralColumns")

string_from_object = FromObject(categories)
byCategoryName = Custom[Filter.ByCategoryName](element_s=all_elements_at_level, category_name_s=string_from_object)  # Filters the input elements by their category name. You can input multiple category names.

# group: Only preselected Category should show here.
watch = Watch(byCategoryName.in)

string = StringInput("Base Offset")
getParameterValueByName = Element.GetParameterValueByName(element=watch, parameterName=string)

# group: Category Base Constraints
watch_2 = Watch(getParameterValueByName)

# group: Activate script
boolean = BoolSelector(false)

string_2 = StringInput("Top Constraint")
getParameterValueByName_2 = Element.GetParameterValueByName(element=watch, parameterName=string_2)
string_from_object_2 = FromObject(getParameterValueByName_2)

# group: 02. Level Above
levels_2 = Levels("02 - Floor")

string_from_object_3 = FromObject(levels_2)
contains = String.Contains(str=string_from_object_2, searchFor=string_from_object_3)
filterByBoolMask = List.FilterByBoolMask(list=watch, mask=contains)
runMe = Custom[Tool.RunMe](Boolean=boolean, ThingToDo=filterByBoolMask.out)  # Use Boolean to perform an action
top_offset = StringInput("Top Offset")

# group: 3. Offset from Level.
number_slider = DoubleSlider(-730.5, range=-900..200 step 0.1)

setParameterByName = Element.SetParameterByName(element=runMe, parameterName=top_offset, value=number_slider)
