# Dynamo graph Sheet Type by Sheet Number.dyn (Dynamo 1.0.0.1180)

boolean = BoolSelector(false)
categories = Categories("Sheets")
runMe = Custom[Tool.RunMe](Boolean=boolean, ThingToDo=categories)  # Use Boolean to perform an action
all_elements_of_category = ElementsOfCategory(runMe)
string = StringInput("Sheet Type")
string_2 = StringInput("Sheet Number")
getParameterValueByName = Element.GetParameterValueByName(element=all_elements_of_category, parameterName=string_2)
sort = List.Sort(getParameterValueByName)
code_block = CodeBlock { 5; }
code_block_2 = CodeBlock { 2; }
remove = String.Remove(str=sort, startIndex=code_block, count=code_block_2)
setParameterByName = Element.SetParameterByName(element=all_elements_of_category, parameterName=string, value=remove)
uniqueItems = List.UniqueItems(remove)
watch = Watch(uniqueItems)
