# Dynamo graph Tag Rooms by Level.dyn (Dynamo 1.0.0.1180)

categories = Categories("Sheets")
all_elements_of_category = ElementsOfCategory(categories)
views = Sheet.Views(all_elements_of_category)
string = StringInput("View Name")
getParameterValueByName = Element.GetParameterValueByName(element=views, parameterName=string)
string_2 = StringInput("Level")
containsKey = ContainsKey(getParameterValueByName, string_2)
filterByBoolMask = List.FilterByBoolMask(list=views, mask=containsKey)
bv_elements_in_views = Custom[bv Elements in Views](Views=filterByBoolMask.out)  # forked
string_from_object = FromObject(bv_elements_in_views)
string_3 = StringInput("Room")
contains = String.Contains(str=string_from_object, searchFor=string_3)
filterByBoolMask_2 = List.FilterByBoolMask(list=string_from_object, mask=contains)
get_boundary_curves_from_room = Custom[Get Boundary Curves from Room List](rooms=filterByBoolMask_2.in)  # use this one
center = Polygon.Center(get_boundary_curves_from_room.boundaryCurves)
create_annotation_tag = Custom[Create Annotation Tag](Tag_Location_s=center, Element=filterByBoolMask_2.in, View=filterByBoolMask.out)  # This node will create an annotation tag at a given location, of given type and in a supplied view. If only single view is supplied then all tags will be created in that view.
watch = Watch(create_annotation_tag)
