# Dynamo graph Unbound Room Element IDs.dyn (Dynamo 0.9.0.3067)

file_path = Filename("T:\narsai-a\20151216 RLA_Unbound-Rooms.csv")
code_block = CodeBlock { ','; }
categories = Categories("Rooms")
all_elements_of_category = ElementsOfCategory(categories)
name = Element.Name(all_elements_of_category)
isUnbounded = Custom[Room.IsUnbounded](Room_s=all_elements_of_category)  # Checks whether a room is unbounded.
filterByBoolMask = List.FilterByBoolMask(list=name, mask=isUnbounded)
watch = Watch(filterByBoolMask.in)
id = Element.Id(all_elements_of_category)
filterByBoolMask_2 = List.FilterByBoolMask(list=id, mask=isUnbounded)
watch_2 = Watch(filterByBoolMask_2.in)
flat_list_to_list_of_strings = Custom[Flat List to List of Strings](Original_List=watch_2)  # using python methods
join = String.Join(code_block, watch, flat_list_to_list_of_strings)
writeToFile = CSV.WriteToFile(file_path, join)
