# Dynamo graph View Names to Upperccase.dyn (Dynamo 1.2.1.3083)

code_block = CodeBlock { "View Name"; }
categories = Categories("Views")
all_elements_of_category = ElementsOfCategory(categories)
getParameterValueByName = Element.GetParameterValueByName(element=all_elements_of_category, parameterName=code_block)
watch = Watch(getParameterValueByName)
toUpper = String.ToUpper(watch)
watch_2 = Watch(toUpper)
setParameterByName = Element.SetParameterByName(parameterName=code_block, value=watch_2)  # unwired: element
watch_3 = Watch(setParameterByName)
