# Dynamo graph Wall Base Offset to Comments Field.dyn (Dynamo 1.0.0.1180)

boolean = BoolSelector(true)
categories = Categories("Walls")
all_elements_of_category = ElementsOfCategory(categories)
runMe = Custom[Tool.RunMe](Boolean=boolean, ThingToDo=all_elements_of_category)  # Use Boolean to perform an action
code_block = CodeBlock { "Comments"; }
code_block_2 = CodeBlock { "Base Offset"; }
getParameterValueByName = Element.GetParameterValueByName(element=all_elements_of_category, parameterName=code_block_2)
string_from_object = FromObject(getParameterValueByName)
code_block_3 = CodeBlock { "."; }
boolean_2 = BoolSelector(true)
removeAfterCharacters = Custom[String.RemoveAfterCharacters](String=string_from_object, Characters=code_block_3, includeChar=boolean_2)  # Removes the part of the string after the input character/s
setParameterByName = Element.SetParameterByName(element=runMe, parameterName=code_block, value=removeAfterCharacters)
