# Dynamo graph Worksets from Model Elements by Category.dyn (Dynamo 1.0.0.1180)

boolean = BoolSelector(false)

# group: Category to define Workset
categories = Categories("Walls")

runMe = Custom[Tool.RunMe](Boolean=boolean, ThingToDo=categories)  # Use Boolean to perform an action
string_from_object = FromObject(runMe)
length = String.Length(string_from_object)
string = StringInput("A-")
length_2 = String.Length(string)
add = length + length_2
padLeft = String.PadLeft(string_from_object, add, string)
create = Custom[Workset.Create](names=padLeft)  # Creates worksets, input is a string or list of strings. Existing worksetnames are ignored.
select_workset_by_name = Custom[Select Workset by Name](worksetName=create)
all_elements_of_category = ElementsOfCategory(runMe)
setWorkset = Custom[Element.SetWorkset](workset=select_workset_by_name, element=all_elements_of_category, lacing=Longest)  # Sets the workset of a given element
flatten = Flatten(setWorkset.changedElements)

# group: Changed Elements
watch = Watch(flatten)

flatten_2 = Flatten(setWorkset.unchangedElements)

# group: Failed to Change Elements
watch_2 = Watch(flatten_2)
