# Dynamo graph Write View Filter List.dyn (Dynamo 0.9.0.3067)

file_path = Filename("T:\narsai-a\20151216 Mackenzie-St_View-Filters.csv")
element_types = ElementTypes("FilterElement")
all_elements_of_type = ElementsOfType(element_types)
name = Element.Name(all_elements_of_type)
writeToFile = CSV.WriteToFile(file_path, name)
watch = Watch(name)
